# Grasshopper definition 220403_meshToThreejs.gh (Grasshopper 1.0.7)
# plug-ins: glTFexporter

# ---- group: Inputs
brep_historical_rebuild_single_family = Brep(<brep referenced from the Rhino model>)
brep_historical_three_storey = Brep(<brep referenced from the Rhino model>)
brep_camera_harvesting = Brep([<brep referenced from the Rhino model> x4])
brep_camera_wildland = Brep([<brep referenced from the Rhino model> x4])
brep_buildings = Brep(flatten([<brep referenced from the Rhino model> x2492]))
mesh_forestfloor = Mesh([<mesh referenced from the Rhino model> x9])
mesh_cliffface = Mesh([<mesh referenced from the Rhino model> x9])
mesh_cityfloor = Mesh([<mesh referenced from the Rhino model> x4])
mesh_riverbed = Mesh(<mesh referenced from the Rhino model>)
brep_camera = Brep([<brep referenced from the Rhino model> x4])
brep_camera_2 = Brep([<brep referenced from the Rhino model> x4])
mesh_ponds = Mesh([<mesh referenced from the Rhino model> x1121])
mesh_roads = Mesh([<mesh referenced from the Rhino model> x1120])

# ----
# GH File Location
relative_gh_file_location = RelativePath()
line = Line()
crv = Curve(<curve referenced from the Rhino model>)
brep_car1 = Brep(<brep referenced from the Rhino model>)
panel = Panel(relative_gh_file_location)
divide = DivideCurve(Curve=crv, Count=10, Kinks=False)  # -> Points, Tangents, Parameters
pline = PolyLine(Vertices=divide.Points, Closed=False)
mesh_building = Mesh(brep_buildings)
join = BrepJoin(Breps=brep_buildings)  # -> Breps, Closed
mjoin = MeshJoin(Meshes=mesh_building)
fmerge = MergeFaces(Brep=join.Breps)  # -> Breps, Before, After
nickname = RelativePath()
mesh_building_2 = Mesh(mjoin)
concat = Concatenate(FragmentA=nickname, FragmentB="/materials/disc.png")
nickname_2 = RelativePath()

# ---- group: Points
medges = MeshEdges(Mesh=mesh_cliffface)  # -> NakedEdges, InteriorEdges, NonManifoldEdges
medges_2 = MeshEdges(Mesh=mesh_forestfloor)  # -> NakedEdges, InteriorEdges, NonManifoldEdges
medges_3 = MeshEdges(Mesh=mesh_riverbed)  # -> NakedEdges, InteriorEdges, NonManifoldEdges
medges_4 = MeshEdges(Mesh=mesh_cityfloor)  # -> NakedEdges, InteriorEdges, NonManifoldEdges
medges_5 = MeshEdges(Mesh=mesh_ponds)  # -> NakedEdges, InteriorEdges, NonManifoldEdges
end = EndPoints(Curve=[medges.NakedEdges, medges.InteriorEdges, medges.NonManifoldEdges])  # -> Start, End
end_2 = EndPoints(Curve=[medges_2.NakedEdges, medges_2.InteriorEdges, medges_2.NonManifoldEdges])  # -> Start, End
end_3 = EndPoints(Curve=[medges_3.NakedEdges, medges_3.InteriorEdges])  # -> Start, End
concat_2 = Concatenate(FragmentA=relative_gh_file_location, FragmentB="/materials/cross2.png")
end_4 = EndPoints(Curve=[medges_4.NakedEdges, medges_4.InteriorEdges])  # -> Start, End
end_5 = EndPoints(Curve=medges_5.InteriorEdges)  # -> Start, End
cullpt = CullDuplicates(Points=[end.Start, end.End], Tolerance=0.1, CullMode=3)  # -> Points, Indices, Valence
cullpt_2 = CullDuplicates(Points=[end_2.Start, end_2.End], Tolerance=0.1, CullMode=3)  # -> Points, Indices, Valence
cullpt_3 = CullDuplicates(Points=[end_3.Start, end_3.End], Tolerance=0.1, CullMode=3)  # -> Points, Indices, Valence
cullpt_4 = CullDuplicates(Points=[end_4.Start, end_4.End], Tolerance=0.1, CullMode=3)  # -> Points, Indices, Valence
texture = Texture(ImagePath=concat_2)
cullpt_5 = CullDuplicates(Points=[end_5.Start, end_5.End], Tolerance=0.1, CullMode=3)  # -> Points, Indices, Valence
pointsmat = PointsMaterial(
    Color=ColourSwatch(SwatchColor=RGB(152, 212, 198)),
    Size=Slider(100, range=0..1000),
    SizeAttenuation=Toggle(True),
    AlphaTest=Slider(0, range=0..1))
pointsmat_2 = PointsMaterial(
    Color=ColourSwatch(SwatchColor=RGB(118, 191, 0)),
    Size=Slider(85, range=0..100),
    SizeAttenuation=Toggle(True),
    AlphaTest=0.5)
pointsmat_3 = PointsMaterial(
    Color=ColourSwatch(SwatchColor=RGB(150, 144, 144)),
    Size=Slider(60, range=0..1000),
    SizeAttenuation=Toggle(True),
    AlphaTest=0.5)
pointsmat_4 = PointsMaterial(
    Color=ColourSwatch(SwatchColor=RGB(167, 224, 235)),
    Size=Slider(100, range=0..1000),
    SizeAttenuation=Toggle(True),
    AlphaTest=Slider(0.2, range=0..1))
pointsmat_5 = PointsMaterial(
    Color=ColourSwatch(SwatchColor=RGB(0, 143, 112)),
    Size=Slider(85, range=0..100),
    SizeAttenuation=Toggle(True),
    AlphaTest=0.5)
points = Points(Points=cullpt.Points, Name="cliffFace", PointsMaterial=pointsmat_5, DecimalAccuracy=3)  # -> flatten(Geometry)
points_2 = Points(Points=cullpt_2.Points, Name="forestFloor", PointsMaterial=pointsmat_2, DecimalAccuracy=3)  # -> flatten(Geometry)
points_3 = Points(Points=cullpt_3.Points, Name="riverbed", PointsMaterial=pointsmat, DecimalAccuracy=3)  # -> flatten(Geometry)
points_4 = Points(Points=cullpt_4.Points, Name="cityFloor", PointsMaterial=pointsmat_3, DecimalAccuracy=3)  # -> flatten(Geometry)
points_5 = Points(Points=cullpt_5.Points, Name="ponds", PointsMaterial=pointsmat_4, DecimalAccuracy=3)  # -> flatten(Geometry)

# ----
concat_3 = Concatenate(FragmentA=nickname_2, FragmentB="/materials/cross.png")
number_slider = Slider(0.3, range=0..10)
edges = BrepEdges(Brep=simplify(flatten(fmerge.Breps)))  # -> Naked, Interior, NonManifold
explode = Explode(Curve=pline, Recursive=True)  # -> Segments, Vertices
texture_2 = Texture(ImagePath=concat)

standardmat = MeshStandardMaterial(
    Color=ColourSwatch(SwatchColor=RGB(15, 255, 243)),
    Opacity=1,
    Roughness=1,
    Metalness=0.5,
    Emissive=RGB(0, 0, 0),
    EmissiveIntensity=1)
standardmat_2 = MeshStandardMaterial(
    Color=ColourSwatch(SwatchColor=RGB(15, 255, 243)),
    Opacity=1,
    Roughness=1,
    Metalness=0.5,
    Emissive=RGB(0, 0, 0),
    EmissiveIntensity=1)
standardmat_3 = MeshStandardMaterial(
    Color=ColourSwatch(SwatchColor=RGB(15, 255, 243)),
    Opacity=1,
    Roughness=1,
    Metalness=0.5,
    Emissive=RGB(0, 0, 0),
    EmissiveIntensity=1)
mesh = Mesh(Mesh=brep_camera_wildland, Name="liveCam1", Material=standardmat, DecimalAccuracy=3)
mesh_2 = Mesh(Mesh=brep_camera_wildland, Name="liveCam1", Material=standardmat_2, DecimalAccuracy=3)
mesh_3 = Mesh(Mesh=brep_camera_wildland, Name="liveCam1", Material=standardmat_3, DecimalAccuracy=3)

texture_3 = Texture(ImagePath=concat_3)
pt = Point(Tree({0;0;0}: [Point(27636.00052, 28657.164, 1235.183396), Point(27964.38552, 28889.38115, 1183.727172), Point(27708.85273, 28703.14349, 1222.763692), Point(27801.44477, 28761.58145, 1223.873381), Point(27816.37109, 28771.00195, 1221.488509), Point(27751.49307, 28750.12837, 1236.96613)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], {0;1;0}: [Point(45727.08992, 14442.47327, 1269.398458), Point(45727.14453, 14443.97754, 1269.081833), Point(45727.12708, 14444.23122, 1269.01703), Point(45726.91641, 14447.29272, 1268.623259), Point(45726.81981, 14448.69668, 1268.358996), Point(45726.94155, 14444.23122, 1268.937664), Point(45726.70132, 14447.07745, 1268.552596), Point(45726.37189, 14451.94866, 1267.638485), Point(45726.30859, 14451.73047, 1267.641686), Point(45726.51019, 14452.25129, 1267.658475)], {0;2;0}: [Point(44446.19346, 10607.8599, 1336.179134), Point(44443.34817, 10682.4648, 1326.370246), Point(44440.89453, 10689.26074, 1326.017642), Point(44440.24235, 10690.07544, 1326.063627), Point(44439.70703, 10690.74414, 1326.101371), Point(44439.41314, 10690.94204, 1326.145934)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], {0;3;0}: [Point(45723.8574, 14444.23122, 1267.618318), Point(45727.08992, 14442.47327, 1269.398458), Point(48406.95166, 17640.76746, 1636.535903), Point(48279.18527, 17512.91223, 1607.123743), Point(47129.28772, 17129.34653, 1432.136967), Point(47001.52133, 17001.4913, 1408.439514)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], {0;4;0}: [Point(45723.77205, 14444.52096, 1248.207227), Point(45727.08992, 14442.47327, 1250.387219), Point(37418.8426, 41530.73273, 1426.577002), Point(37035.54342, 39998.32062, 1413.080691), Point(36396.68298, 39487.49682, 1378.229328), Point(36268.91659, 39359.78623, 1351.737495)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], {0;5;0}: [Point(8415.47271, 41530.73273, 1702.374052), Point(8287.706316, 38593.52643, 1645.906869), Point(8159.939923, 37954.95869, 1619.531824), Point(7776.640742, 37060.93641, 1561.740521), Point(7648.874349, 36933.21471, 1569.17172), Point(7393.341562, 36805.49671, 1545.371039)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], {0;6;0}: [Point(18764.69293, 41530.73273, 1623.168596), Point(23364.34003, 41530.73273, 1668.424455), Point(28602.84757, 41530.73273, 1938.781516), Point(23108.80724, 39998.32062, 1773.38455), Point(22981.04085, 39615.20369, 1759.195057), Point(18764.69293, 39232.07935, 1581.826153)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], {0;7;0}: [Point(33969.09303, 41530.73273, 1881.637341), Point(33841.32664, 41275.33751, 1888.676837), Point(33458.02746, 39487.49682, 1878.529337), Point(33969.09303, 35783.70826, 1807.855055), Point(33969.09303, 33867.74556, 1850.448528), Point(33841.32664, 33484.53227, 1860.939948)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], {0;8;0}: [Point(31285.9703, 41530.73273, 1765.57768), Point(31924.80227, 34889.60815, 1665.714442), Point(31541.50309, 34634.14621, 1617.776076), Point(31413.7367, 34250.94774, 1609.312176), Point(31285.9703, 33995.47839, 1634.044646), Point(31030.43751, 33612.27251, 1587.058973)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]))

standardmat_4 = MeshStandardMaterial(
    Color=ColourSwatch(SwatchColor=RGB(247, 57, 165)),
    Opacity=1,
    Roughness=1,
    Metalness=0.5,
    Emissive=RGB(0, 0, 0),
    EmissiveIntensity=1)
standardmat_5 = MeshStandardMaterial(
    Color=ColourSwatch(SwatchColor=RGB(247, 57, 165)),
    Opacity=1,
    Roughness=1,
    Metalness=0.5,
    Emissive=RGB(0, 0, 0),
    EmissiveIntensity=1)
mesh_4 = Mesh(Mesh=brep_historical_three_storey, Name="historicalPtBuiltOut", Material=standardmat_4, DecimalAccuracy=3)
mesh_5 = Mesh(Mesh=brep_historical_rebuild_single_family, Name="historicalPtConstruction", Material=standardmat_5, DecimalAccuracy=3)

panel_2 = Panel("-10,-10,-10")
pointsmat_6 = PointsMaterial(Color=RGB(255, 255, 255), Size=Slider(0.2, range=0..10), SizeAttenuation=True, AlphaMap=texture_2, AlphaTest=0.5)
linebasicmat = LineBasicMaterial(Color=ColourSwatch(SwatchColor=RGB(199, 199, 199)), LineWidth=Slider(2, range=0..10))
standardmat_6 = MeshStandardMaterial(Color=RGB(255, 255, 255), Opacity="0", Roughness=1, Metalness=0.5, Emissive=RGB(0, 0, 0), EmissiveIntensity=1)
linebasicmat_2 = LineBasicMaterial(Color=ColourSwatch(SwatchColor=RGB(248, 255, 112)), LineWidth="10")
standardmat_7 = MeshStandardMaterial(
    Color=ColourSwatch(SwatchColor=RGB(33, 33, 33)),
    Opacity=Slider(1, range=0..1),
    Roughness=1,
    Metalness=0.5,
    Emissive=RGB(0, 0, 0),
    EmissiveIntensity=1)
standardmat_8 = MeshStandardMaterial(
    Color=ColourSwatch(SwatchColor=RGB(217, 137, 0)),
    Opacity=1,
    Roughness=1,
    Metalness=0.5,
    Emissive=RGB(0, 0, 0),
    EmissiveIntensity=1)
line_2 = Line(Line=edges.Interior, LineMaterial=linebasicmat, DecimalAccuracy=3)
mesh_6 = Mesh(Mesh=mesh_roads, Name="roads", Material=standardmat_6, DecimalAccuracy=3)
mesh_7 = Mesh(Mesh=mesh_building_2, Name="buildings", Material=standardmat_7, DecimalAccuracy=3)
mesh_8 = Mesh(Mesh=brep_car1, Name="car1", Material=standardmat_8, DecimalAccuracy=3)
line_3 = Line(Line=pline, Name="road1", LineMaterial=linebasicmat_2, DecimalAccuracy=3)

# ---- group: lighting
hemilight = HempisphereLight(
    Color=ColourSwatch(SwatchColor=RGB(178, 194, 194)),
    GroundColor=ColourSwatch(SwatchColor=RGB(0, 0, 0)),
    Intensity=Slider(5, range=0..10),
    Name="hemisphere light")
ambientlight = AmbientLight(Color=ColourSwatch(SwatchColor=RGB(255, 255, 255)), Intensity=Slider(0.05, range=0..1), Name="ambient light")

# ----
scene = CompileScene(
    Objects=[hemilight, points_5, points, points_2, points_3, ambientlight, points_4, mesh_6, mesh_7, mesh_2, mesh_5, mesh_4, mesh_8],
    BackgroundColor=ColourSwatch(SwatchColor=RGB(0, 0, 0)))
button = Button()
concat_4 = Concatenate(FragmentA=relative_gh_file_location, FragmentB="/assets")

serialize = SerializeObject(Object3d=scene, Minify=False, Run=button)

# ---- group: Serve Your Website
concat_5 = Concatenate(FragmentA=relative_gh_file_location, FragmentB="/www")
http = HTTPServer(Path=concat_5, Run=Toggle(True))

# ----
writetxt = WriteTextFile(Path=concat_4, FileName="groundPoints.json", Data=serialize, Write=button)

# ---- group: Black Surface
merge = Merge(Data1=mesh_cliffface, Data2=mesh_forestfloor, Data3=mesh_riverbed, Data4=mesh_cityfloor)
Z = UnitZ(Factor="-200")
mesh_9 = Mesh(merge)
move = Move(Geometry=mesh_9, Motion=Z)  # -> Geometry, Transform
standardmat_9 = MeshStandardMaterial(
    Color=ColourSwatch(SwatchColor=RGB(51, 51, 51)),
    Opacity=1,
    Roughness=1,
    Metalness=0.5,
    Emissive=RGB(0, 0, 0),
    EmissiveIntensity=1)

# ----
mesh_10 = Mesh(move.Geometry)

# ---- group: Black Surface (continued)
mesh_11 = Mesh(Mesh=mesh_10, Material=standardmat_9, DecimalAccuracy=3)
